# Grasshopper definition 250925_cxm-tests.gh (Grasshopper 1.0.8)
# plug-ins: Bifocals

# ----
# GCD WITH TOLERANCE
number_slider = Slider(3, range=-3..4)
panel = Panel(<missing>)

# ---- group: case_algorithms_2
geo = Geometry([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])

# ---- group: case_element_hash
plane = Data(Tree({0;0;0;5}: [PlaneXY(162161.1001, 14976.31562, 0)], {0;0;0;7}: [PlaneXY(162161.1001, 17976.31562, 0)], {0;0;0;9}: [PlaneXY(162161.1001, 20976.31562, 0)], {0;0;0;11}: [PlaneXY(162161.1001, 23976.31562, 0)], {0;0;0;13}: [PlaneXY(162161.1001, 26976.31562, 0)], {0;0;0;15}: [PlaneXY(162161.1001, 29976.31562, 0)]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))
gab = Curve(Tree({0;0;0;5}: [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], {0;0;0;7}: [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], {0;0;0;9}: [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], {0;0;0;11}: [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], {0;0;0;13}: [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], {0;0;0;15}: [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]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))
kont = Curve(flatten(Tree({0;0;0;5}: [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], {0;0;0;7}: [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], {0;0;0;9}: [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], {0;0;0;11}: [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], {0;0;0;13}: [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], {0;0;0;15}: [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]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)))
name = Data(Tree({0;0;0;5}: ["XB-1-6"], {0;0;0;7}: ["XB-1-8"], {0;0;0;9}: ["XB-1-10"], {0;0;0;11}: ["XB-1-12"], {0;0;0;13}: ["XB-1-14"], {0;0;0;15}: ["XB-1-16"]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))

# ----
# DEFINE MESH ATTRIBUTES
mesh = Mesh(Tree({0;0}: [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], {0;1}: [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], {0;2}: [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], {0;3}: [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], {0;4}: [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], {0;5}: [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]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))

# ---- group: case_element_hash
curve = Curve(flatten([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]))

# ----
# MESH ATTRIBUTES TO FILE
panel_4 = Panel("C:\temp\MeshAttr.txt")
list = ValueList({"bake": True, "none": False}, selected="none")
writemeshattr = WriteMeshAttributes(panel=<missing>, vertices=<missing>, panel_area=<missing>, bake=list, edges_lengths=<missing>, path=panel_4)
panel_5 = Panel(writemeshattr)

# ----
# MATCH CURVES
cluster = Cluster(relay=kont, T=name, crv=curve)  # -> G, ad
crv = Curve(cluster.G)
annotation_dot = AnnotationDot(cluster.ad)

# ----
# PANELS INSET
number_slider_2 = Slider(46.377, range=0..103)
inset_mesh = InsetMesh(M=<missing>, num=number_slider_2)  # -> frames, panels, out
panel_6 = Panel(inset_mesh.out)
preview = CustomPreview(
    Geometry=simplify([inset_mesh.frames, inset_mesh.panels]),
    Material=[ColourSwatch(SwatchColor=RGB(72, 255, 149)), ColourSwatch(SwatchColor=RGB(255, 88, 106))])

# ----
# DEFINE CUSTOM PREVIEW
swatch = ColourSwatch(SwatchColor=RGB(219, 209, 111))
entwine = Entwine(Branch00=<missing>, Branch01=<missing>, Branch02=<missing>, FlattenInputs=True)
preview_2 = CustomPreview(
    Geometry=entwine,
    Material=graft([swatch, ColourSwatch(SwatchColor=RGB(158, 255, 255)), ColourSwatch(SwatchColor=RGB(190, 116, 255))]))

# ---- group: case_algorithms_3
geo_2 = Geometry(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)

# ----
# PANELS BY PERIMETER
panel_thickness = Slider(35, range=0..100)
panel_bevel = Slider(50, range=0..100)
panel_height = Slider(4500, range=0..10000)
panel_width = Slider(1000, range=0..2000)
pnl_by_perimeter = PnlByPerimeter(D=panel_thickness, d=panel_bevel, F=panel_height, relay=panel_width, C=geo_2)  # -> A, B, crv_2, R
panel_7 = Panel(pnl_by_perimeter.R)
entwine_2 = Entwine(Branch00=pnl_by_perimeter.A, Branch01=pnl_by_perimeter.B, Branch02=pnl_by_perimeter.crv_2, FlattenInputs=True)
preview_3 = CustomPreview(
    Geometry=entwine_2,
    Material=graft([ColourSwatch(SwatchColor=RGB(183, 69, 255)), ColourSwatch(SwatchColor=RGB(72, 213, 255)), ColourSwatch(SwatchColor=RGB(101, 86, 74))]))

# ==== cluster WriteMeshAttributes
edges_lengths = ClusterInput()
panel = ClusterInput()
panel_area = ClusterInput()
vertices = ClusterInput()

# ----
# VERTICES
pt = Point(vertices)
rep = ReplaceText(Text="vertex [n]: ", Find="n", Replace=["0", "1", "2"], RecursiveReplace=False)
concat = Concatenate(FragmentA=rep, FragmentB=pt)
item = ListItem(List=concat, Index=0, Wrap=True)  # -> Item, Item1, Item2

# ----
# PANEL
tstat = TreeStatistics(Tree=panel)  # -> Paths, Length, Count
series = Series(Start=0, Step=1, Count=tstat.Length)
series_2 = Series(Start=0, Step=1, Count=tstat.Count)
concat_2 = Concatenate(FragmentA=series_2, FragmentB="-")
concat_3 = Concatenate(FragmentA=graft(concat_2), FragmentB=series)
concat_4 = Concatenate(FragmentA="p-", FragmentB=concat_3)
concat_5 = Concatenate(FragmentA="panel tag: ", FragmentB=concat_4)

# ----
# AREA
num = Number(panel_area)
concat_6 = Concatenate(FragmentA="panel area (m2): ", FragmentB=num)

# ----
# EDGES LEN
num_2 = Number(edges_lengths)
join = TextJoin(Text=num_2, Join=", ")
concat_7 = Concatenate(FragmentA="edge len (m): ", FragmentB=join)

entwine = Entwine(
    Branch00=concat_5,
    Branch01=concat_6,
    Branch02=item.Item,
    Branch03=item.Item1,
    Branch04=item.Item2,
    Branch05=concat_7,
    FlattenInputs=True)
panel_2 = Panel("""PANELS ATTRIBUTES
__________________________""")
flip = FlipMatrix(Data=entwine)
path = ClusterInput()
bake = ClusterInput()
replace = ReplaceItems(List=flip, Item="_________________________", Indices=6, Wrap=False)  # -> flatten(List)
concat_8 = Concatenate(FragmentA=panel_2)
ins = InsertItems(List=replace, Item=concat_8, Indices=0, Wrap=True)
ins_2 = InsertItems(List=ins, Item="QUERY ENDED", Indices=-1, Wrap=True)
py3 = Python3Script(txt=ins_2, path=path, bake=bake)  # -> out; inputs txt: list of String, bake: Boolean
# ---------- py3: Python ----------
if bake:
    with open(path, 'w') as file:
        for line in txt:
            file.write(str(line) + "\n")
    print(f"mesh attributes were written to file located at '{path}'")
else:
    pass
# ---------- end py3 ----------
out = ClusterOutput(py3)

# ==== cluster InsetMesh
num = ClusterInput()
num_2 = Number(num)
M = ClusterInput()
explode = MeshExplode(Mesh=M, Interpolate=False)
flatten = FlattenTree(Tree=explode, Path="{0}")  # -> graft(Tree)
medges = MeshEdges(Mesh=flatten)  # -> NakedEdges, InteriorEdges, NonManifoldEdges
join = JoinCurves(Curves=medges.NakedEdges, Preserve=False)
crv = Curve(join)
disc = Discontinuity(Curve=crv, Level=1)  # -> Points, Parameters
item = ListItem(List=disc.Points, Index=0, Wrap=True)  # -> Item, Item1, Item2
explode_2 = Explode(Curve=crv, Recursive=True)  # -> Segments, Vertices
icentre = Incentre(PointA=item.Item, PointB=item.Item1, PointC=item.Item2)  # -> Incentre, BisectorA, BisectorB, BisectorC
item_2 = ListItem(List=explode_2.Segments, Index=0, Wrap=True)
crv_cp = CurveClosestPoint(Point=icentre.Incentre, Curve=item_2)  # -> Point, Parameter, Distance
dist = Distance(PointA=icentre.Incentre, PointB=crv_cp.Point)
number_slider = Slider(0.001, range=0..0.001)
sort = SortList(Keys=flatten(dist))  # -> Keys, ValuesA
item_3 = ListItem(List=sort.Keys, Index=0, Wrap=True)
setdoctolerance = CSharpScript(x=number_slider)
# ---------- setdoctolerance: C# ----------
// Grasshopper Script Instance
#region Usings
using System;
using System.Linq;
using System.Collections;
using System.Collections.Generic;
using System.Drawing;

using Rhino;
using Rhino.Geometry;

using Grasshopper;
using Grasshopper.Kernel;
using Grasshopper.Kernel.Data;
using Grasshopper.Kernel.Types;
#endregion

public class Script_Instance : GH_ScriptInstance
{
    #region Notes
    /* 
      Members:
        RhinoDoc RhinoDocument
        GH_Document GrasshopperDocument
        IGH_Component Component
        int Iteration

      Methods (Virtual & overridable):
        Print(string text)
        Print(string format, params object[] args)
        Reflect(object obj)
        Reflect(object obj, string method_name)
    */
    #endregion

    private void RunScript(object x)
    {
        Rhino.RhinoDoc.ActiveDoc.ModelAbsoluteTolerance = 0.001;
    }
}
# ---------- end setdoctolerance ----------
multiplication = Multiplication(A=item_3, B=number_slider)
panel = Panel(item_3)
subtraction = Subtraction(A=item_3, B=multiplication)
division = Division(A=subtraction, B=2)
larger = LargerThan(FirstNumber=num_2, SecondNumber=subtraction)  # -> LargerThan, OrEqualTo
smaller = SmallerThan(FirstNumber=num_2, SecondNumber=number_slider)  # -> SmallerThan, OrEqualTo
equals = Equality(FirstNumber=smaller.SmallerThan, SecondNumber=0)  # -> Equality, Inequality
equals_2 = Equality(FirstNumber=larger.LargerThan, SecondNumber=0)  # -> Equality, Inequality
filter = StreamFilter(Gate=larger.LargerThan, Stream0=num_2, Stream1=division)
panel_2 = Panel("the offset value exceeds allowed bounds. bounds average is applied (_average).")
rep = ReplaceText(
    Text="successful inset. allowed inset value bounds [min, max].",
    Find="min",
    Replace=number_slider,
    RecursiveReplace=False)
and = GateAnd(A=equals_2.Equality, B=equals.Equality)
filter_2 = StreamFilter(Gate=smaller.SmallerThan, Stream0=filter, Stream1=division)
neg = Negative(Value=filter_2)
rep_2 = ReplaceText(Text=panel_2, Find="_average", Replace=division, RecursiveReplace=False)
rep_3 = ReplaceText(Text=rep, Find="max", Replace=subtraction, RecursiveReplace=False)
filter_3 = StreamFilter(Gate=and, Stream0=rep_2, Stream1=rep_3)
panel_3 = Panel(filter_3)
suirify = Suirify(join)
offset_l = OffsetCurveLoose(Curve=suirify, Distance=neg)
explode_3 = Explode(Curve=simplify(suirify), Recursive=True)  # -> Segments, Vertices
explode_4 = Explode(Curve=simplify(offset_l), Recursive=True)  # -> Segments, Vertices
smesh = SimpleMesh(Brep=offset_l)
merge = Merge(Data1=graft(explode_3.Segments), Data2=graft(explode_4.Segments))
loft = Loft(Curves=merge, Options={Adjust=False, Closed=False, LoftEnds=0, LoftSimp=0, LoftType=0, Rebuild=10, Refit=0.01})
pshift = ShiftPaths(Data=loft, Offset=-1)
smesh_2 = SimpleMesh(Brep=pshift)
mjoin = MeshJoin(Meshes=smesh_2)
weld = WeldMesh(Mesh=mjoin, Angle=3.141592654)
mesh = Mesh(simplify(weld))
mesh_2 = Mesh(smesh)

# ---- group: Cluster Output
out = ClusterOutput(filter_3)

# ---- group: frames
panels = ClusterOutput(mesh_2)

# ----
preview = CustomPreview(Geometry=[offset_l, join], Material=ColourSwatch(SwatchColor=RGB(0, 0, 68)))
frames = ClusterOutput(mesh)

# ==== cluster Cluster
crv = ClusterInput()
relay = ClusterInput()
crv_2 = Curve(crv)
crv_3 = Curve(relay)
disc = Discontinuity(Curve=crv_3, Level=1)  # -> Points, Parameters
avr = Average(Input=disc.Points)
disc_2 = Discontinuity(Curve=crv_2, Level=1)  # -> Points, Parameters
avr_2 = Average(Input=disc_2.Points)
dist = Distance(PointA=disc_2.Points, PointB=avr_2)
dist_2 = Distance(PointA=disc.Points, PointB=avr)
ma = MassAddition(Input=dist)  # -> flatten(Result), PartialResults
ma_2 = MassAddition(Input=dist_2)  # -> flatten(Result), PartialResults
crossref = CrossReference(ListA=flatten(ma_2.Result), ListB=graft(ma.Result), CrossMode=1)  # -> ListA, ListB
equalst = EqualityWithinTolerance(FirstNumber=crossref.ListA, SecondNumber=crossref.ListB, Tolerance=0.001)  # -> Equality, Inequality
cull = CullPattern(List=flatten(crv_3), CullPattern=equalst.Equality)
entwine = Entwine(Branch00=cull, Branch01=crv_2, FlattenInputs=True)
flip = FlipMatrix(Data=entwine)
area = Area(Geometry=flip)  # -> Area, Centroid
item = ListItem(List=area.Centroid, Index=0, Wrap=True)  # -> Item, Item1
move2pt = MoveToPoint(Geometry=graft(crv_2), PointA=item.Item1, PointB=graft(item.Item))  # -> Moved, Vector, Transform
explode = Explode(Curve=move2pt.Moved, Recursive=True)  # -> Segments, Vertices
explode_2 = Explode(Curve=relay, Recursive=True)  # -> Segments, Vertices
len = Length(Curve=explode.Segments)
len_2 = Length(Curve=explode_2.Segments)
sort = SortList(Keys=len, ValuesA=explode.Segments)  # -> Keys, ValuesA
sort_2 = SortList(Keys=len_2, ValuesA=explode_2.Segments)  # -> Keys, ValuesA
item_2 = ListItem(List=reverse(sort.ValuesA), Index=0, Wrap=True)  # -> Item, Item1, Item2
item_3 = ListItem(List=reverse(sort_2.ValuesA), Index=0, Wrap=True)  # -> Item, Item1, Item2
mp = Midpoint(Curve=[item_2.Item, item_2.Item1, item_2.Item2])
mp_2 = Midpoint(Curve=[item_3.Item, item_3.Item1, item_3.Item2])
item_4 = ListItem(List=mp_2, Index=0, Wrap=True)  # -> Item, Item1, Item2
item_5 = ListItem(List=mp, Index=0, Wrap=True)  # -> Item, Item1, Item2
pl_3pt = Plane3Pt(PointA=item_4.Item, PointB=item_4.Item1, PointC=item_4.Item2)
pl_3pt_2 = Plane3Pt(PointA=item_5.Item, PointB=item_5.Item1, PointC=item_5.Item2)
orient = Orient(Geometry=move2pt.Moved, Source=pl_3pt_2, Target=pl_3pt)  # -> Geometry, Transform
xy = XYPlane(Origin=item.Item)
T = ClusterInput()
G = ClusterOutput(orient.Geometry)
dot = AnnotationDot(Location=xy, PrimaryText=T)  # -> AnnotationDot, Location, PrimaryText, TextHeight
ad = ClusterOutput(dot.AnnotationDot)

# ==== cluster PnlByPerimeter
C = ClusterInput()
relay = ClusterInput()

explode = Explode(Curve=C, Recursive=True)  # -> reparameterize(Segments), Vertices
len = Length(Curve=explode.Segments)
int = Integer(len)
division = Division(A=int, B=relay)
round = Round(Number=division)  # -> Nearest, Floor, Ceiling
multiplication = Multiplication(A=relay, B=round.Floor)
subtraction = Subtraction(A=int, B=multiplication)
lng = ListLength(List=subtraction)

panel = Panel(len)
panel_2 = Panel(int)

divlength = DivideLength(Curve=reparameterize(explode.Segments), Length=relay)  # -> Points, Tangents, Parameters
shatter = Shatter(Curve=graft(explode.Segments), Parameters=divlength.Parameters)  # -> flatten(Segments)
len_2 = Length(Curve=shatter)
equalst = EqualityWithinTolerance(FirstNumber=len_2, SecondNumber=relay, Tolerance=0.001)  # -> Equality, Inequality

panel_3 = Panel(multiplication)
D = ClusterInput()
d = ClusterInput()
F = ClusterInput()
mesh_fast_extrude = MeshFastExtrude(D=D, x=d, F=F, crv=shatter)

dispatch = Dispatch(List=mesh_fast_extrude, DispatchPattern=equalst.Inequality)  # -> ListA, ListB
series = Series(Start=0, Step=1, Count=lng)
lng_2 = ListLength(List=dispatch.ListB)
format = Format(Format="{0:000}", Culture=127, Data0=series)
area = Area(Geometry=dispatch.ListA)  # -> Area, Centroid
concat = Concatenate(FragmentA="unique-", FragmentB=format)
dot = AnnotationDot(Location=area.Centroid, PrimaryText=concat)  # -> AnnotationDot, Location, PrimaryText, TextHeight
rep = ReplaceText(Text="panels amount with non-type dimensions: ~", Find="~", Replace=lng, RecursiveReplace=False)
rep_2 = ReplaceText(Text="panels amount with standard dimensions: ~", Find="~", Replace=lng_2, RecursiveReplace=False)

A = ClusterOutput(dispatch.ListA)
B = ClusterOutput(dispatch.ListB)
medges = MeshEdges(Mesh=mesh_fast_extrude)  # -> NakedEdges, InteriorEdges, NonManifoldEdges
merge = Merge(Data1=rep_2, Data2=rep)  # -> flatten(Result)
crv = Curve(medges.InteriorEdges)
R = ClusterOutput(merge)
crv_2 = ClusterOutput(crv)

# ==== cluster MeshFastExtrude
x = ClusterInput()
crv = ClusterInput()
neg = Negative(Value=x)
crv_2 = Curve(crv)
D = ClusterInput()
offset_l = OffsetCurveLoose(Curve=crv_2, Distance=expr("-x", D))
ext = ExtendCurve(Curve=offset_l, Type=0, Start=neg, End=neg)
entwine = Entwine(Branch00=ext, Branch01=crv_2, FlattenInputs=True)
flip = FlipMatrix(Data=entwine)
loft = Loft(Curves=flip, Options={Adjust=False, Closed=False, LoftEnds=0, LoftSimp=0, LoftType=0, Rebuild=10, Refit=0.01})
edges = BrepEdges(Brep=loft)  # -> graft(Naked), Interior, NonManifold
F = ClusterInput()
Z = UnitZ(Factor=F)
move = Move(Geometry=edges.Naked, Motion=Z)  # -> Geometry, Transform
move_2 = Move(Geometry=loft, Motion=Z)  # -> Geometry, Transform
entwine_2 = Entwine(Branch0X=move.Geometry, Branch1X=edges.Naked, FlattenInputs=False)  # -> simplify(Result)
split = SplitTree(Data=entwine_2, Masks=flatten("{0;?;?}"))  # -> Positive, Negative
path_mapper = PathMapper(split.Negative, source="{A;B;C}", target="{0;B;C}")
merge = Merge(Data1=split.Positive, Data2=path_mapper)
loft_2 = Loft(Curves=merge, Options={Adjust=False, Closed=False, LoftEnds=0, LoftSimp=0, LoftType=0, Rebuild=10, Refit=0.01})
pshift = ShiftPaths(Data=loft_2, Offset=-1)
smesh = SimpleMesh(Brep=[move_2.Geometry, loft, pshift])
mjoin = MeshJoin(Meshes=smesh)  # -> flatten(Mesh)
M = ClusterOutput(mjoin)
